# Grasshopper definition Lorenz_Attractor_01.gh (Grasshopper 1.0.7)

timer = Timer(TimerInterval=200, Target=c_script)
division = Division(A=Slider(8, range=0..10), B=Slider(3, range=0..10))
c_script = CSharpScript(count=Slider(5, range=0..6000), rho=Slider(28, range=0..100), sigma=Slider(10, range=0..10), beta=division)  # -> out, A; inputs count: Int32, rho: Double, sigma: Double, beta: Double
# ---------- c_script: C# ----------
    // reference : https://www.algosome.com/articles/lorenz-attractor-programming-code.html
    stop += 5;

    List<Point3d> pts = new List<Point3d>();

    double t = 0.01;

    Point3d state = new Point3d(0.1, 0, 0);
    pts.Add(state);

    for (int i = 0; i < stop; i++){

      double xt = state.X + t * sigma * (state.Y - state.X);
      double yt = state.Y + t * (state.X * (rho - state.Z) - state.Y);
      double zt = state.Z + t * (state.X * state.Y - beta * state.Z);
      state = new Point3d(xt, yt, zt);
      pts.Add(state);

    }


    A = pts;
# ---------- c_script: C# additional code ----------
  int start ;
  int stop ;
# ---------- end c_script ----------
interpolate = Interpolate(Vertices=c_script.A, Degree=3, Periodic=False, KnotStyle=1)  # -> Curve, Length, Domain
panel = Panel(c_script.out)
panel_2 = Panel(interpolate.Curve)
